# Grasshopper definition lantern_grasshopper.gh (Grasshopper 1.0.8)

number_slider = Slider(150, range=0..300)
pt = Point(Point(0, 0, 0))
subtraction = Subtraction(A=number_slider, B=Slider(1, range=0..1))
series = Series(Start=0, Step=Slider(1, range=0..1), Count=number_slider)
range = Range(Domain=Domain(0, 1), Steps=subtraction)
Z = UnitZ(Factor=series)
pi = Pi(Factor=range)
move = Move(Geometry=pt, Motion=Z)  # -> Geometry, Transform
sin = Sine(Value=pi)
num = Number(sin)
multiplication = Multiplication(A=num, B=Slider(20, range=0..100))
addition = Addition(A=multiplication, B=Slider(40, range=0..100))
cir = Circle(Plane=move.Geometry, Radius=addition)
divide = DivideCurve(Curve=cir, Count=Slider(100, range=0..100), Kinks=False)  # -> Points, Tangents, Parameters
shatter = Shatter(Curve=graft(cir), Parameters=divide.Parameters)  # -> simplify(Segments)
offset = OffsetCurve(Curve=cir, Distance=Slider(-1, range=-1..1), Corners=1)
eval = EvaluateLength(Curve=shatter, Length=Slider(0.5, range=0..1), Normalized=False)  # -> Point, Tangent, Parameter
loft = Loft(Curves=flatten(offset), Options={Adjust=False, Closed=False, LoftEnds=0, LoftSimp=0, LoftType=0, Rebuild=10, Refit=0.01})
shatter_2 = Shatter(Curve=simplify(graft(shatter)), Parameters=simplify(graft(eval.Parameter)))  # -> simplify(Segments)
num_2 = Number(num)
item = ListItem(List=shatter_2, Index=0, Wrap=True)  # -> Item, Item1
multiplication_2 = Multiplication(A=num_2, B=Slider(5, range=0..10))
crv = Curve(item.Item)
crv_2 = Curve(item.Item1)
trim = TrimTree(Tree=crv, Depth=1)
offset_2 = OffsetCurve(Curve=trim, Distance=graft(multiplication_2), Corners=1)  # -> simplify(Curve)
end = EndPoints(Curve=graft(trim))  # -> Start, End
end_2 = EndPoints(Curve=graft(offset_2))  # -> Start, End
ln = Line(StartPoint=end.End, EndPoint=end_2.End)
ln_2 = Line(StartPoint=end.Start, EndPoint=end_2.Start)
merge = Merge(Data1=simplify(graft(ln_2)), Data2=simplify(graft(offset_2)), Data3=simplify(graft(ln)), Data4=simplify(graft(crv_2)))
num_3 = Number(num)
pi_2 = Pi(Factor=num_3)
trim_2 = TrimTree(Tree=merge, Depth=1)
join = JoinCurves(Curves=trim_2, Preserve=False)
rotate = Rotate(Geometry=flatten(join), Angle=pi_2, Plane=PlaneXY(0, 0, 0))  # -> Geometry, Transform
loft_2 = Loft(Curves=rotate.Geometry, Options={Adjust=False, Closed=False, LoftEnds=0, LoftSimp=0, LoftType=0, Rebuild=10, Refit=0.01})
cap = CapHoles(Brep=loft)
cap_2 = CapHoles(Brep=loft_2)
sdiff = SolidDifference(BrepsA=cap_2, BrepsB=cap)
